% Simulink data dictionary neck_mk3.sldd

Vcc = 48

Physical_MechanicalLinks = Simulink.ConnectionBus()
  Element: Connection: simmechanics.connections.geometry

MCU_Ts = 0.001
PWM_frequency = 20000

Physical_MotorPhases = Simulink.ConnectionBus()
  Motor1_Pos: Connection: foundation.electrical.electrical
  Motor1_Neg: Connection: foundation.electrical.electrical
  Motor2_Pos: Connection: foundation.electrical.electrical
  Motor2_Neg: Connection: foundation.electrical.electrical
  Motor3_Pos: Connection: foundation.electrical.electrical
  Motor3_Neg: Connection: foundation.electrical.electrical

Physical_Velocities = Simulink.ConnectionBus()
  Velocity1: Connection: foundation.mechanical.rotational.rotational
  Velocity2: Connection: foundation.mechanical.rotational.rotational
  Velocity3: Connection: foundation.mechanical.rotational.rotational

Physical_Torques = Simulink.ConnectionBus()
  Torque1: Connection: foundation.mechanical.rotational.rotational
  Torque2: Connection: foundation.mechanical.rotational.rotational
  Torque3: Connection: foundation.mechanical.rotational.rotational

Physical_Positions = Simulink.ConnectionBus()
  Position1: Connection: foundation.mechanical.rotational.rotational
  Position2: Connection: foundation.mechanical.rotational.rotational
  Position3: Connection: foundation.mechanical.rotational.rotational

Data_ControlCommands = Simulink.Bus()
  Voltage: single[3], Min=-100, Max=100, Unit="%"  % Actuation voltage signals.

Data_ControlFeedback = Simulink.Bus()
  Encoders: single[3], Unit="deg"

Data_JointReferences = Simulink.Bus()
  SetPoints: single[3], Unit="deg"  % Setpoints that the system needs to track.

Data_Measurements = Simulink.Bus()
  Encoders: single[3], Unit="deg"