# Requirement set neck_functional_requirements (R2023b)

## 1 [NeckFR_1] Sensing (Container)

### 1.1 [NeckFR_2] Disambiguate kinematic configurations from sensor readings
We shall be always able to reconstruct the kinematic configuration of the mechanism univocally.
This means that the sensors shall be mounted on the structure accordingly to provide suitable readings that help to disambiguate aby possible configuration.
Rationale: An example that we aim to prevent from striking and disrupting our efforts.
- We use an absolute sensing system (e.g., AEA sensors)
- However, the sensors may be subject to multiturns behaviors.
- As a result, we lose the possibility to disambiguate kinematic configurations from the sensor readings.